# Grasshopper definition SURE_RESEARCH_HOSPITAL FLOOR PLAN OPTIMIZATION_0714_PYTHON_SUN.gh (Grasshopper 1.0.7)

# ----
# IT2 CHANGES: 1__The Number of selected grid cell taken from the average was switch from nearest to ceilling
# 2__the cell outline group was limited to one component (to much flafla)
# 3__the plan outline was reconfigured (no black plan)
# 4__RESPECT AREA objective for double select crv issues
number_slider = Slider(10, range=0..1000)
number_slider_2 = Slider(10, range=0..100)
sqgrid = Square(Plane=PlaneXY(0, 0, 0), Size=number_slider, ExtentX=number_slider_2, ExtentY=number_slider_2)  # -> Cells, Points
area = Area(Geometry=flatten(sqgrid.Cells))  # -> Area, Centroid
ma = MassAddition(Input=area.Area)  # -> Result, PartialResults
total_grid_area = Panel(ma.Result)

# ---- group: ROOM AREA
panel = Panel("""3
3
1
1
1
1
3
3
6
3
3
2
4
6
3
5
2
1
2
1
1""")
number_slider_3 = Slider(0.7, range=0..1000)
ma_2 = MassAddition(Input=panel)  # -> Result, PartialResults
expression = Expression(x=number_slider, y=ma_2.Result, Expression="x²*y")
total_area = Panel(expression)

# ----
panel_2 = Panel("""0
2
40
0
0
1
9
39
32
123
123
111
111""")
panel_3 = Panel("""0
2
22
1
0
3
8
56
39
7
4
13
51
85""")
panel_4 = Panel("""2
6
7
0
0
2
62
8
9
24
16
52
113
9
56""")
panel_5 = Panel("""7
32
7
6
3
3
13
1
15
10
13
13
31
15
1
13""")
panel_6 = Panel("""2
6
7
0
0
2""")
panel_7 = Panel("""0
2
40
0
0
1
9
85""")
panel_8 = Panel("""3
8
0
0
0
0
24
7
123""")
panel_9 = Panel("""1
3
0
1
0
0
16
4
123
151""")
panel_10 = Panel("""3
3
12
11
0
0
52
13
111
22
16""")
panel_11 = Panel("""5
5
85
43
11
4
113
51
111
20
13
182""")
panel_12 = Panel("""0
0
295""")
panel_13 = Panel("""2
1
6
0""")
panel_14 = Panel("""0
0
0
0
3""")
panel_15 = Panel("""0
2
22
1
0
3
56""")
panel_16 = Panel("""3
9
0
4
1
0
3
0
0
3
0
49
10
0
0
3
26""")
panel_17 = Panel("""9
1
11
7
0
0
2
7
8
3
1
6
50
8
7
2
27
2""")
panel_18 = Panel("""21
14
130
2
13
2
8
14
3
0
3
8
90
3
14
8
13
33
48""")
panel_19 = Panel("""10
30
21
28
6
0
3
7
0
0
0
0
16
0
7
3
5
0
50
119""")
panel_20 = Panel("""8
4""")
entwine = Entwine(
    Branch01="41",
    Branch02=panel_20,
    Branch03=panel_12,
    Branch04=panel_13,
    Branch05=panel_14,
    Branch06=panel_6,
    Branch07=panel_15,
    Branch08=panel_7,
    Branch09=panel_8,
    Branch010=panel_9,
    Branch011=panel_10,
    Branch012=panel_11,
    Branch013=panel_2,
    Branch014=panel_3,
    Branch015=panel_4,
    Branch016=panel_5,
    Branch017=panel_16,
    Branch018=panel_17,
    Branch019=panel_18,
    Branch020=panel_19,
    FlattenInputs=True)  # -> simplify(Result)
panel_21 = Panel(entwine)

room_title = Panel("""Sister's changing room
Nurse's  changing room
Surgeon's rest room
Surgeon's changing room
Superintendent's room
Medical store
Small theatre
Anaesthetic room no.1
Theatre no.1
Sink room
Sterling room
Scrub up room
Ante-space and nurse's station
Theatre no.2
Anaesthetic room no.2
Emergency theatre
Work room and clean supply
Sterile supply room
Male staff changing room
Nurse's station
The entrance""")
graft = GraftTree(Tree=room_title, IncludeEmptyLists=True, IncludeNullItems=True)  # -> simplify(Tree)

panel_22 = Panel("""0
0
0
0
0
0
11
0
0
0
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""")
grid_cell = Data(flatten(sqgrid.Cells))

python_list = Data(panel_22)
grid_cell_2 = Data(grid_cell)
equals = Equality(FirstNumber=python_list, SecondNumber="2")  # -> Equality, Inequality
dispatch = Dispatch(List=python_list, DispatchPattern=equals.Equality)  # -> ListA, ListB
index = ItemIndex(List=python_list, Item=dispatch.ListA)
item = ListItem(List=grid_cell_2, Index=index, Wrap=True)

python_list_2 = Data(panel_22)
grid_cell_3 = Data(grid_cell)
equals_2 = Equality(FirstNumber=python_list_2, SecondNumber="1")  # -> Equality, Inequality
dispatch_2 = Dispatch(List=python_list_2, DispatchPattern=equals_2.Equality)  # -> ListA, ListB
index_2 = ItemIndex(List=python_list_2, Item=dispatch_2.ListA)
item_2 = ListItem(List=grid_cell_3, Index=index_2, Wrap=True)

python_list_3 = Data(panel_22)
grid_cell_4 = Data(grid_cell)
equals_3 = Equality(FirstNumber=python_list_3, SecondNumber="3")  # -> Equality, Inequality
dispatch_3 = Dispatch(List=python_list_3, DispatchPattern=equals_3.Equality)  # -> ListA, ListB
index_3 = ItemIndex(List=python_list_3, Item=dispatch_3.ListA)
item_3 = ListItem(List=grid_cell_4, Index=index_3, Wrap=True)

python_list_4 = Data(panel_22)
grid_cell_5 = Data(grid_cell)
equals_4 = Equality(FirstNumber=python_list_4, SecondNumber="4")  # -> Equality, Inequality
dispatch_4 = Dispatch(List=python_list_4, DispatchPattern=equals_4.Equality)  # -> ListA, ListB
index_4 = ItemIndex(List=python_list_4, Item=dispatch_4.ListA)
item_4 = ListItem(List=grid_cell_5, Index=index_4, Wrap=True)

python_list_5 = Data(panel_22)
grid_cell_6 = Data(grid_cell)
equals_5 = Equality(FirstNumber=python_list_5, SecondNumber="10")  # -> Equality, Inequality
dispatch_5 = Dispatch(List=python_list_5, DispatchPattern=equals_5.Equality)  # -> ListA, ListB
index_5 = ItemIndex(List=python_list_5, Item=dispatch_5.ListA)
item_5 = ListItem(List=grid_cell_6, Index=index_5, Wrap=True)

python_list_6 = Data(panel_22)
grid_cell_7 = Data(grid_cell)
equals_6 = Equality(FirstNumber=python_list_6, SecondNumber="5")  # -> Equality, Inequality
dispatch_6 = Dispatch(List=python_list_6, DispatchPattern=equals_6.Equality)  # -> ListA, ListB
index_6 = ItemIndex(List=python_list_6, Item=dispatch_6.ListA)
item_6 = ListItem(List=grid_cell_7, Index=index_6, Wrap=True)

python_list_7 = Data(panel_22)
grid_cell_8 = Data(grid_cell)
equals_7 = Equality(FirstNumber=python_list_7, SecondNumber="6")  # -> Equality, Inequality
dispatch_7 = Dispatch(List=python_list_7, DispatchPattern=equals_7.Equality)  # -> ListA, ListB
index_7 = ItemIndex(List=python_list_7, Item=dispatch_7.ListA)
item_7 = ListItem(List=grid_cell_8, Index=index_7, Wrap=True)

python_list_8 = Data(panel_22)
grid_cell_9 = Data(grid_cell)
equals_8 = Equality(FirstNumber=python_list_8, SecondNumber="8")  # -> Equality, Inequality
dispatch_8 = Dispatch(List=python_list_8, DispatchPattern=equals_8.Equality)  # -> ListA, ListB
index_8 = ItemIndex(List=python_list_8, Item=dispatch_8.ListA)
item_8 = ListItem(List=grid_cell_9, Index=index_8, Wrap=True)

python_list_9 = Data(panel_22)
grid_cell_10 = Data(grid_cell)
equals_9 = Equality(FirstNumber=python_list_9, SecondNumber="9")  # -> Equality, Inequality
dispatch_9 = Dispatch(List=python_list_9, DispatchPattern=equals_9.Equality)  # -> ListA, ListB
index_9 = ItemIndex(List=python_list_9, Item=dispatch_9.ListA)
item_9 = ListItem(List=grid_cell_10, Index=index_9, Wrap=True)

python_list_10 = Data(panel_22)
grid_cell_11 = Data(grid_cell)
equals_10 = Equality(FirstNumber=python_list_10, SecondNumber="11")  # -> Equality, Inequality
dispatch_10 = Dispatch(List=python_list_10, DispatchPattern=equals_10.Equality)  # -> ListA, ListB
index_10 = ItemIndex(List=python_list_10, Item=dispatch_10.ListA)
item_10 = ListItem(List=grid_cell_11, Index=index_10, Wrap=True)

python_list_11 = Data(panel_22)
grid_cell_12 = Data(grid_cell)
equals_11 = Equality(FirstNumber=python_list_11, SecondNumber="12")  # -> Equality, Inequality
dispatch_11 = Dispatch(List=python_list_11, DispatchPattern=equals_11.Equality)  # -> ListA, ListB
index_11 = ItemIndex(List=python_list_11, Item=dispatch_11.ListA)
item_11 = ListItem(List=grid_cell_12, Index=index_11, Wrap=True)

python_list_12 = Data(panel_22)
grid_cell_13 = Data(grid_cell)
equals_12 = Equality(FirstNumber=python_list_12, SecondNumber="17")  # -> Equality, Inequality
dispatch_12 = Dispatch(List=python_list_12, DispatchPattern=equals_12.Equality)  # -> ListA, ListB
index_12 = ItemIndex(List=python_list_12, Item=dispatch_12.ListA)
item_12 = ListItem(List=grid_cell_13, Index=index_12, Wrap=True)

python_list_13 = Data(panel_22)
grid_cell_14 = Data(grid_cell)
equals_13 = Equality(FirstNumber=python_list_13, SecondNumber="7")  # -> Equality, Inequality
dispatch_13 = Dispatch(List=python_list_13, DispatchPattern=equals_13.Equality)  # -> ListA, ListB
index_13 = ItemIndex(List=python_list_13, Item=dispatch_13.ListA)
item_13 = ListItem(List=grid_cell_14, Index=index_13, Wrap=True)

python_list_14 = Data(panel_22)
grid_cell_15 = Data(grid_cell)
equals_14 = Equality(FirstNumber=python_list_14, SecondNumber="13")  # -> Equality, Inequality
dispatch_14 = Dispatch(List=python_list_14, DispatchPattern=equals_14.Equality)  # -> ListA, ListB
index_14 = ItemIndex(List=python_list_14, Item=dispatch_14.ListA)
item_14 = ListItem(List=grid_cell_15, Index=index_14, Wrap=True)

python_list_15 = Data(panel_22)
grid_cell_16 = Data(grid_cell)
equals_15 = Equality(FirstNumber=python_list_15, SecondNumber="14")  # -> Equality, Inequality
dispatch_15 = Dispatch(List=python_list_15, DispatchPattern=equals_15.Equality)  # -> ListA, ListB
index_15 = ItemIndex(List=python_list_15, Item=dispatch_15.ListA)
item_15 = ListItem(List=grid_cell_16, Index=index_15, Wrap=True)

python_list_16 = Data(panel_22)
grid_cell_17 = Data(grid_cell)
equals_16 = Equality(FirstNumber=python_list_16, SecondNumber="16")  # -> Equality, Inequality
dispatch_16 = Dispatch(List=python_list_16, DispatchPattern=equals_16.Equality)  # -> ListA, ListB
index_16 = ItemIndex(List=python_list_16, Item=dispatch_16.ListA)
item_16 = ListItem(List=grid_cell_17, Index=index_16, Wrap=True)

python_list_17 = Data(panel_22)
grid_cell_18 = Data(grid_cell)
equals_17 = Equality(FirstNumber=python_list_17, SecondNumber="15")  # -> Equality, Inequality
dispatch_17 = Dispatch(List=python_list_17, DispatchPattern=equals_17.Equality)  # -> ListA, ListB
index_17 = ItemIndex(List=python_list_17, Item=dispatch_17.ListA)
item_17 = ListItem(List=grid_cell_18, Index=index_17, Wrap=True)

python_list_18 = Data(panel_22)
grid_cell_19 = Data(grid_cell)
equals_18 = Equality(FirstNumber=python_list_18, SecondNumber="18")  # -> Equality, Inequality
dispatch_18 = Dispatch(List=python_list_18, DispatchPattern=equals_18.Equality)  # -> ListA, ListB
index_18 = ItemIndex(List=python_list_18, Item=dispatch_18.ListA)
item_18 = ListItem(List=grid_cell_19, Index=index_18, Wrap=True)

python_list_19 = Data(panel_22)
grid_cell_20 = Data(grid_cell)
equals_19 = Equality(FirstNumber=python_list_19, SecondNumber="19")  # -> Equality, Inequality
dispatch_19 = Dispatch(List=python_list_19, DispatchPattern=equals_19.Equality)  # -> ListA, ListB
index_19 = ItemIndex(List=python_list_19, Item=dispatch_19.ListA)
item_19 = ListItem(List=grid_cell_20, Index=index_19, Wrap=True)

python_list_20 = Data(panel_22)
grid_cell_21 = Data(grid_cell)
equals_20 = Equality(FirstNumber=python_list_20, SecondNumber="20")  # -> Equality, Inequality
dispatch_20 = Dispatch(List=python_list_20, DispatchPattern=equals_20.Equality)  # -> ListA, ListB
index_20 = ItemIndex(List=python_list_20, Item=dispatch_20.ListA)
item_20 = ListItem(List=grid_cell_21, Index=index_20, Wrap=True)

python_list_21 = Data(panel_22)
grid_cell_22 = Data(grid_cell)
equals_21 = Equality(FirstNumber=python_list_21, SecondNumber="21")  # -> Equality, Inequality
dispatch_21 = Dispatch(List=python_list_21, DispatchPattern=equals_21.Equality)  # -> ListA, ListB
index_21 = ItemIndex(List=python_list_21, Item=dispatch_21.ListA)
item_21 = ListItem(List=grid_cell_22, Index=index_21, Wrap=True)

# ---- group: CELL-OutLine
runion = RegionUnion(Curves=item_19)
runion_2 = RegionUnion(Curves=item_21)
runion_3 = RegionUnion(Curves=item_15)
runion_4 = RegionUnion(Curves=item_12)
runion_5 = RegionUnion(Curves=item_18)
runion_6 = RegionUnion(Curves=item_20)
runion_7 = RegionUnion(Curves=item_9)
runion_8 = RegionUnion(Curves=item_11)
runion_9 = RegionUnion(Curves=item_14)
runion_10 = RegionUnion(Curves=item_17)
runion_11 = RegionUnion(Curves=item_16)
runion_12 = RegionUnion(Curves=item_4)
runion_13 = RegionUnion(Curves=item_10)
runion_14 = RegionUnion(Curves=item_13)
runion_15 = RegionUnion(Curves=item_8)
runion_16 = RegionUnion(Curves=item_5)
runion_17 = RegionUnion(Curves=item)
runion_18 = RegionUnion(Curves=item_3)
runion_19 = RegionUnion(Curves=item_6)
runion_20 = RegionUnion(Curves=item_7)
runion_21 = RegionUnion(Curves=item_2)
item_22 = ListItem(List=runion, Index=0, Wrap=True)  # -> flatten(Item)
item_23 = ListItem(List=runion_2, Index=0, Wrap=True)  # -> flatten(Item)
item_24 = ListItem(List=runion_3, Index=0, Wrap=True)  # -> flatten(Item)
item_25 = ListItem(List=runion_4, Index=0, Wrap=True)  # -> flatten(Item)
item_26 = ListItem(List=runion_5, Index=0, Wrap=True)  # -> flatten(Item)
item_27 = ListItem(List=runion_6, Index=0, Wrap=True)  # -> flatten(Item)
item_28 = ListItem(List=runion_21, Index=0, Wrap=True)  # -> flatten(Item)
item_29 = ListItem(List=runion_7, Index=0, Wrap=True)  # -> flatten(Item)
item_30 = ListItem(List=runion_8, Index=0, Wrap=True)  # -> flatten(Item)
item_31 = ListItem(List=runion_9, Index=0, Wrap=True)  # -> flatten(Item)
item_32 = ListItem(List=runion_10, Index=0, Wrap=True)  # -> flatten(Item)
item_33 = ListItem(List=runion_11, Index=0, Wrap=True)  # -> flatten(Item)
item_34 = ListItem(List=runion_12, Index=0, Wrap=True)  # -> flatten(Item)
item_35 = ListItem(List=runion_13, Index=0, Wrap=True)  # -> flatten(Item)
item_36 = ListItem(List=runion_14, Index=0, Wrap=True)  # -> flatten(Item)
item_37 = ListItem(List=runion_15, Index=0, Wrap=True)  # -> flatten(Item)
item_38 = ListItem(List=runion_16, Index=0, Wrap=True)  # -> flatten(Item)
item_39 = ListItem(List=runion_17, Index=0, Wrap=True)  # -> flatten(Item)
item_40 = ListItem(List=runion_18, Index=0, Wrap=True)  # -> flatten(Item)
item_41 = ListItem(List=runion_19, Index=0, Wrap=True)  # -> flatten(Item)
item_42 = ListItem(List=runion_20, Index=0, Wrap=True)  # -> flatten(Item)

# ----
merge = Merge(
    Data1=item_28,
    Data2=item_39,
    Data3=item_40,
    Data4=item_34,
    Data5=item_41,
    Data6=item_42,
    Data7=item_36,
    Data8=item_37,
    Data9=item_29,
    Data10=item_38,
    Data11=item_35,
    Data12=item_30,
    Data13=item_31,
    Data14=item_24,
    Data15=item_32,
    Data16=item_33,
    Data17=item_25,
    Data18=item_26,
    Data19=item_22,
    Data20=item_27,
    Data21=item_23)

# ---- group: CELL-OutL_G
wall_thickness = Number(number_slider_3)
geo = Geometry(merge)
offset = OffsetCurve(Curve=geo, Distance=wall_thickness, Plane=PlaneXY(0, 0, 0), Corners=1)  # -> flatten(Curve)
boundary = BoundarySurfaces(Edges=offset)
runion_22 = RegionUnion(Curves=boundary)
neg = Negative(Value=wall_thickness)
offset_2 = OffsetCurve(Curve=runion_22, Distance=expr("x+0.01", neg), Plane=PlaneXY(0, 0, 0), Corners=1)  # -> flatten(Curve)

# ---- group: RE-ORDERED LIST
area_2 = Area(Geometry=merge)  # -> Area, Centroid

# ----
data_list = Data(panel_21)
bang = ExplodeTree(Data=data_list)  # -> Branch0, Branch1, Branch2, Branch3, Branch4, Branch5, Branch6, Branch7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

# ---- group: TEXT
text = Data(graft)
flatten = FlattenTree(Tree=text, Path="{0}")
index_22 = ItemIndex(List=flatten, Item=flatten)
addition = Addition(A=index_22, B="1")
concat = Concatenate(FragmentA=addition, FragmentB="_", FragmentC=flatten)
text_center = Geometry(area_2.Centroid)
text_2 = Data(concat)
tag = TextTag(Location=area_2.Centroid, Text=concat, Colour=ColourSwatch(SwatchColor=RGB(0, 0, 0)))

# ----
wall_thickness_2 = Number(number_slider_3)
neg_2 = Negative(Value=wall_thickness_2)
offset_3 = OffsetCurve(Curve=merge, Distance=expr("x/4", neg_2), Plane=PlaneXY(0, 0, 0), Corners=1)
boundary_2 = BoundarySurfaces(Edges=flatten(offset_3))
lng = ListLength(List=boundary_2)
expression_2 = Expression(x=lng, Expression="1/x")
series = Series(Start=0, Step=expression_2, Count=lng)
gradient = Gradient(
    LowerLimit=0,
    UpperLimit=1,
    Parameter=series,
    stops=[0: RGB(128, 0, 0), 0.16: RGB(234, 38, 0), 0.317: RGB(234, 126, 0), 0.68: RGB(173, 203, 249), 0.84: RGB(75, 107, 169), 1: RGB(25, 25, 112)])
preview = CustomPreview(Geometry=boundary_2, Material=gradient)

# ---- group: EVAL
area_center_re_ordered_list = Data(area_2.Centroid)
split = SplitList(List=area_center_re_ordered_list, Index=expr("x+1", "1"))  # -> ListA, ListB
cull_i = CullIndex(List=split.ListA, Indices="1", Wrap=True)
item_43 = ListItem(List=split.ListA, Index="1", Wrap=True)
pdecon = Deconstruct(Point=item_43)  # -> XComponent, YComponent, ZComponent
pdecon_2 = Deconstruct(Point=cull_i)  # -> XComponent, YComponent, ZComponent
subtraction = Subtraction(A=pdecon.XComponent, B=pdecon_2.XComponent)
subtraction_2 = Subtraction(A=pdecon.YComponent, B=pdecon_2.YComponent)
abs = Absolute(Value=subtraction_2)
abs_2 = Absolute(Value=subtraction)
addition_2 = Addition(A=abs_2, B=abs)  # -> flatten(Result)
multiplication = Multiplication(A=bang.Branch1, B=addition_2)
ma_3 = MassAddition(Input=multiplication)  # -> Result, PartialResults

area_center_re_ordered_list_2 = Data(area_2.Centroid)
split_2 = SplitList(List=area_center_re_ordered_list_2, Index=expr("x+1", "2"))  # -> ListA, ListB
cull_i_2 = CullIndex(List=split_2.ListA, Indices="2", Wrap=True)
item_44 = ListItem(List=split_2.ListA, Index="2", Wrap=True)
pdecon_3 = Deconstruct(Point=item_44)  # -> XComponent, YComponent, ZComponent
pdecon_4 = Deconstruct(Point=cull_i_2)  # -> XComponent, YComponent, ZComponent
subtraction_3 = Subtraction(A=pdecon_3.XComponent, B=pdecon_4.XComponent)
subtraction_4 = Subtraction(A=pdecon_3.YComponent, B=pdecon_4.YComponent)
abs_3 = Absolute(Value=subtraction_4)
abs_4 = Absolute(Value=subtraction_3)
addition_3 = Addition(A=abs_4, B=abs_3)  # -> flatten(Result)
multiplication_2 = Multiplication(A=bang.Branch2, B=addition_3)
ma_4 = MassAddition(Input=multiplication_2)  # -> Result, PartialResults

area_center_re_ordered_list_3 = Data(area_2.Centroid)
split_3 = SplitList(List=area_center_re_ordered_list_3, Index=expr("x+1", "3"))  # -> ListA, ListB
cull_i_3 = CullIndex(List=split_3.ListA, Indices="3", Wrap=True)
item_45 = ListItem(List=split_3.ListA, Index="3", Wrap=True)
pdecon_5 = Deconstruct(Point=item_45)  # -> XComponent, YComponent, ZComponent
pdecon_6 = Deconstruct(Point=cull_i_3)  # -> XComponent, YComponent, ZComponent
subtraction_5 = Subtraction(A=pdecon_5.XComponent, B=pdecon_6.XComponent)
subtraction_6 = Subtraction(A=pdecon_5.YComponent, B=pdecon_6.YComponent)
abs_5 = Absolute(Value=subtraction_6)
abs_6 = Absolute(Value=subtraction_5)
addition_4 = Addition(A=abs_6, B=abs_5)  # -> flatten(Result)
multiplication_3 = Multiplication(A=bang.Branch3, B=addition_4)
ma_5 = MassAddition(Input=multiplication_3)  # -> Result, PartialResults

area_center_re_ordered_list_4 = Data(area_2.Centroid)
split_4 = SplitList(List=area_center_re_ordered_list_4, Index=expr("x+1", "4"))  # -> ListA, ListB
cull_i_4 = CullIndex(List=split_4.ListA, Indices="4", Wrap=True)
item_46 = ListItem(List=split_4.ListA, Index="4", Wrap=True)
pdecon_7 = Deconstruct(Point=item_46)  # -> XComponent, YComponent, ZComponent
pdecon_8 = Deconstruct(Point=cull_i_4)  # -> XComponent, YComponent, ZComponent
subtraction_7 = Subtraction(A=pdecon_7.XComponent, B=pdecon_8.XComponent)
subtraction_8 = Subtraction(A=pdecon_7.YComponent, B=pdecon_8.YComponent)
abs_7 = Absolute(Value=subtraction_8)
abs_8 = Absolute(Value=subtraction_7)
addition_5 = Addition(A=abs_8, B=abs_7)  # -> flatten(Result)
multiplication_4 = Multiplication(A=bang.Branch4, B=addition_5)
ma_6 = MassAddition(Input=multiplication_4)  # -> Result, PartialResults

area_center_re_ordered_list_5 = Data(area_2.Centroid)
split_5 = SplitList(List=area_center_re_ordered_list_5, Index=expr("x+1", "5"))  # -> ListA, ListB
cull_i_5 = CullIndex(List=split_5.ListA, Indices="5", Wrap=True)
item_47 = ListItem(List=split_5.ListA, Index="5", Wrap=True)
pdecon_9 = Deconstruct(Point=item_47)  # -> XComponent, YComponent, ZComponent
pdecon_10 = Deconstruct(Point=cull_i_5)  # -> XComponent, YComponent, ZComponent
subtraction_9 = Subtraction(A=pdecon_9.XComponent, B=pdecon_10.XComponent)
subtraction_10 = Subtraction(A=pdecon_9.YComponent, B=pdecon_10.YComponent)
abs_9 = Absolute(Value=subtraction_10)
abs_10 = Absolute(Value=subtraction_9)
addition_6 = Addition(A=abs_10, B=abs_9)  # -> flatten(Result)
multiplication_5 = Multiplication(A=bang.Branch5, B=addition_6)
ma_7 = MassAddition(Input=multiplication_5)  # -> Result, PartialResults

area_center_re_ordered_list_6 = Data(area_2.Centroid)
split_6 = SplitList(List=area_center_re_ordered_list_6, Index=expr("x+1", "6"))  # -> ListA, ListB
cull_i_6 = CullIndex(List=split_6.ListA, Indices="6", Wrap=True)
item_48 = ListItem(List=split_6.ListA, Index="6", Wrap=True)
pdecon_11 = Deconstruct(Point=item_48)  # -> XComponent, YComponent, ZComponent
pdecon_12 = Deconstruct(Point=cull_i_6)  # -> XComponent, YComponent, ZComponent
subtraction_11 = Subtraction(A=pdecon_11.XComponent, B=pdecon_12.XComponent)
subtraction_12 = Subtraction(A=pdecon_11.YComponent, B=pdecon_12.YComponent)
abs_11 = Absolute(Value=subtraction_12)
abs_12 = Absolute(Value=subtraction_11)
addition_7 = Addition(A=abs_12, B=abs_11)  # -> flatten(Result)
multiplication_6 = Multiplication(A=bang.Branch6, B=addition_7)
ma_8 = MassAddition(Input=multiplication_6)  # -> Result, PartialResults

area_center_re_ordered_list_7 = Data(area_2.Centroid)
split_7 = SplitList(List=area_center_re_ordered_list_7, Index=expr("x+1", "7"))  # -> ListA, ListB
cull_i_7 = CullIndex(List=split_7.ListA, Indices="7", Wrap=True)
item_49 = ListItem(List=split_7.ListA, Index="7", Wrap=True)
pdecon_13 = Deconstruct(Point=item_49)  # -> XComponent, YComponent, ZComponent
pdecon_14 = Deconstruct(Point=cull_i_7)  # -> XComponent, YComponent, ZComponent
subtraction_13 = Subtraction(A=pdecon_13.XComponent, B=pdecon_14.XComponent)
subtraction_14 = Subtraction(A=pdecon_13.YComponent, B=pdecon_14.YComponent)
abs_13 = Absolute(Value=subtraction_14)
abs_14 = Absolute(Value=subtraction_13)
addition_8 = Addition(A=abs_14, B=abs_13)  # -> flatten(Result)
multiplication_7 = Multiplication(A=bang.Branch7, B=addition_8)
ma_9 = MassAddition(Input=multiplication_7)  # -> Result, PartialResults

area_center_re_ordered_list_8 = Data(area_2.Centroid)
split_8 = SplitList(List=area_center_re_ordered_list_8, Index=expr("x+1", "8"))  # -> ListA, ListB
cull_i_8 = CullIndex(List=split_8.ListA, Indices="8", Wrap=True)
item_50 = ListItem(List=split_8.ListA, Index="8", Wrap=True)
pdecon_15 = Deconstruct(Point=item_50)  # -> XComponent, YComponent, ZComponent
pdecon_16 = Deconstruct(Point=cull_i_8)  # -> XComponent, YComponent, ZComponent
subtraction_15 = Subtraction(A=pdecon_15.XComponent, B=pdecon_16.XComponent)
subtraction_16 = Subtraction(A=pdecon_15.YComponent, B=pdecon_16.YComponent)
abs_15 = Absolute(Value=subtraction_16)
abs_16 = Absolute(Value=subtraction_15)
addition_9 = Addition(A=abs_16, B=abs_15)  # -> flatten(Result)
multiplication_8 = Multiplication(A=bang.Branch8, B=addition_9)
ma_10 = MassAddition(Input=multiplication_8)  # -> Result, PartialResults

area_center_re_ordered_list_9 = Data(area_2.Centroid)
split_9 = SplitList(List=area_center_re_ordered_list_9, Index=expr("x+1", "9"))  # -> ListA, ListB
cull_i_9 = CullIndex(List=split_9.ListA, Indices="9", Wrap=True)
item_51 = ListItem(List=split_9.ListA, Index="9", Wrap=True)
pdecon_17 = Deconstruct(Point=item_51)  # -> XComponent, YComponent, ZComponent
pdecon_18 = Deconstruct(Point=cull_i_9)  # -> XComponent, YComponent, ZComponent
subtraction_17 = Subtraction(A=pdecon_17.XComponent, B=pdecon_18.XComponent)
subtraction_18 = Subtraction(A=pdecon_17.YComponent, B=pdecon_18.YComponent)
abs_17 = Absolute(Value=subtraction_18)
abs_18 = Absolute(Value=subtraction_17)
addition_10 = Addition(A=abs_18, B=abs_17)  # -> flatten(Result)
multiplication_9 = Multiplication(A=bang.Branch9, B=addition_10)
ma_11 = MassAddition(Input=multiplication_9)  # -> Result, PartialResults

area_center_re_ordered_list_10 = Data(area_2.Centroid)
split_10 = SplitList(List=area_center_re_ordered_list_10, Index=expr("x+1", "10"))  # -> ListA, ListB
cull_i_10 = CullIndex(List=split_10.ListA, Indices="10", Wrap=True)
item_52 = ListItem(List=split_10.ListA, Index="10", Wrap=True)
pdecon_19 = Deconstruct(Point=item_52)  # -> XComponent, YComponent, ZComponent
pdecon_20 = Deconstruct(Point=cull_i_10)  # -> XComponent, YComponent, ZComponent
subtraction_19 = Subtraction(A=pdecon_19.XComponent, B=pdecon_20.XComponent)
subtraction_20 = Subtraction(A=pdecon_19.YComponent, B=pdecon_20.YComponent)
abs_19 = Absolute(Value=subtraction_20)
abs_20 = Absolute(Value=subtraction_19)
addition_11 = Addition(A=abs_20, B=abs_19)  # -> flatten(Result)
multiplication_10 = Multiplication(A=bang.Branch10, B=addition_11)
ma_12 = MassAddition(Input=multiplication_10)  # -> Result, PartialResults

area_center_re_ordered_list_11 = Data(area_2.Centroid)
split_11 = SplitList(List=area_center_re_ordered_list_11, Index=expr("x+1", "11"))  # -> ListA, ListB
cull_i_11 = CullIndex(List=split_11.ListA, Indices="11", Wrap=True)
item_53 = ListItem(List=split_11.ListA, Index="11", Wrap=True)
pdecon_21 = Deconstruct(Point=item_53)  # -> XComponent, YComponent, ZComponent
pdecon_22 = Deconstruct(Point=cull_i_11)  # -> XComponent, YComponent, ZComponent
subtraction_21 = Subtraction(A=pdecon_21.XComponent, B=pdecon_22.XComponent)
subtraction_22 = Subtraction(A=pdecon_21.YComponent, B=pdecon_22.YComponent)
abs_21 = Absolute(Value=subtraction_22)
abs_22 = Absolute(Value=subtraction_21)
addition_12 = Addition(A=abs_22, B=abs_21)  # -> flatten(Result)
multiplication_11 = Multiplication(A=bang.Branch11, B=addition_12)
ma_13 = MassAddition(Input=multiplication_11)  # -> Result, PartialResults

area_center_re_ordered_list_12 = Data(area_2.Centroid)
split_12 = SplitList(List=area_center_re_ordered_list_12, Index=expr("x+1", "12"))  # -> ListA, ListB
cull_i_12 = CullIndex(List=split_12.ListA, Indices="12", Wrap=True)
item_54 = ListItem(List=split_12.ListA, Index="12", Wrap=True)
pdecon_23 = Deconstruct(Point=item_54)  # -> XComponent, YComponent, ZComponent
pdecon_24 = Deconstruct(Point=cull_i_12)  # -> XComponent, YComponent, ZComponent
subtraction_23 = Subtraction(A=pdecon_23.XComponent, B=pdecon_24.XComponent)
subtraction_24 = Subtraction(A=pdecon_23.YComponent, B=pdecon_24.YComponent)
abs_23 = Absolute(Value=subtraction_24)
abs_24 = Absolute(Value=subtraction_23)
addition_13 = Addition(A=abs_24, B=abs_23)  # -> flatten(Result)
multiplication_12 = Multiplication(A=bang.Branch12, B=addition_13)
ma_14 = MassAddition(Input=multiplication_12)  # -> Result, PartialResults

area_center_re_ordered_list_13 = Data(area_2.Centroid)
split_13 = SplitList(List=area_center_re_ordered_list_13, Index=expr("x+1", "13"))  # -> ListA, ListB
cull_i_13 = CullIndex(List=split_13.ListA, Indices="13", Wrap=True)
item_55 = ListItem(List=split_13.ListA, Index="13", Wrap=True)
pdecon_25 = Deconstruct(Point=item_55)  # -> XComponent, YComponent, ZComponent
pdecon_26 = Deconstruct(Point=cull_i_13)  # -> XComponent, YComponent, ZComponent
subtraction_25 = Subtraction(A=pdecon_25.XComponent, B=pdecon_26.XComponent)
subtraction_26 = Subtraction(A=pdecon_25.YComponent, B=pdecon_26.YComponent)
abs_25 = Absolute(Value=subtraction_26)
abs_26 = Absolute(Value=subtraction_25)
addition_14 = Addition(A=abs_26, B=abs_25)  # -> flatten(Result)
multiplication_13 = Multiplication(A=bang.Branch13, B=addition_14)
ma_15 = MassAddition(Input=multiplication_13)  # -> Result, PartialResults

area_center_re_ordered_list_14 = Data(area_2.Centroid)
split_14 = SplitList(List=area_center_re_ordered_list_14, Index=expr("x+1", "14"))  # -> ListA, ListB
cull_i_14 = CullIndex(List=split_14.ListA, Indices="14", Wrap=True)
item_56 = ListItem(List=split_14.ListA, Index="14", Wrap=True)
pdecon_27 = Deconstruct(Point=item_56)  # -> XComponent, YComponent, ZComponent
pdecon_28 = Deconstruct(Point=cull_i_14)  # -> XComponent, YComponent, ZComponent
subtraction_27 = Subtraction(A=pdecon_27.XComponent, B=pdecon_28.XComponent)
subtraction_28 = Subtraction(A=pdecon_27.YComponent, B=pdecon_28.YComponent)
abs_27 = Absolute(Value=subtraction_28)
abs_28 = Absolute(Value=subtraction_27)
addition_15 = Addition(A=abs_28, B=abs_27)  # -> flatten(Result)
multiplication_14 = Multiplication(A=bang.Branch14, B=addition_15)
ma_16 = MassAddition(Input=multiplication_14)  # -> Result, PartialResults

area_center_re_ordered_list_15 = Data(area_2.Centroid)
split_15 = SplitList(List=area_center_re_ordered_list_15, Index=expr("x+1", "15"))  # -> ListA, ListB
cull_i_15 = CullIndex(List=split_15.ListA, Indices="15", Wrap=True)
item_57 = ListItem(List=split_15.ListA, Index="15", Wrap=True)
pdecon_29 = Deconstruct(Point=item_57)  # -> XComponent, YComponent, ZComponent
pdecon_30 = Deconstruct(Point=cull_i_15)  # -> XComponent, YComponent, ZComponent
subtraction_29 = Subtraction(A=pdecon_29.XComponent, B=pdecon_30.XComponent)
subtraction_30 = Subtraction(A=pdecon_29.YComponent, B=pdecon_30.YComponent)
abs_29 = Absolute(Value=subtraction_30)
abs_30 = Absolute(Value=subtraction_29)
addition_16 = Addition(A=abs_30, B=abs_29)  # -> flatten(Result)
multiplication_15 = Multiplication(A=bang.Branch15, B=addition_16)
ma_17 = MassAddition(Input=multiplication_15)  # -> Result, PartialResults

area_center_re_ordered_list_16 = Data(area_2.Centroid)
split_16 = SplitList(List=area_center_re_ordered_list_16, Index=expr("x+1", "16"))  # -> ListA, ListB
cull_i_16 = CullIndex(List=split_16.ListA, Indices="16", Wrap=True)
item_58 = ListItem(List=split_16.ListA, Index="16", Wrap=True)
pdecon_31 = Deconstruct(Point=item_58)  # -> XComponent, YComponent, ZComponent
pdecon_32 = Deconstruct(Point=cull_i_16)  # -> XComponent, YComponent, ZComponent
subtraction_31 = Subtraction(A=pdecon_31.XComponent, B=pdecon_32.XComponent)
subtraction_32 = Subtraction(A=pdecon_31.YComponent, B=pdecon_32.YComponent)
abs_31 = Absolute(Value=subtraction_32)
abs_32 = Absolute(Value=subtraction_31)
addition_17 = Addition(A=abs_32, B=abs_31)  # -> flatten(Result)
multiplication_16 = Multiplication(A=bang.Branch16, B=addition_17)
ma_18 = MassAddition(Input=multiplication_16)  # -> Result, PartialResults

area_center_re_ordered_list_17 = Data(area_2.Centroid)
split_17 = SplitList(List=area_center_re_ordered_list_17, Index=expr("x+1", "17"))  # -> ListA, ListB
cull_i_17 = CullIndex(List=split_17.ListA, Indices="17", Wrap=True)
item_59 = ListItem(List=split_17.ListA, Index="17", Wrap=True)
pdecon_33 = Deconstruct(Point=item_59)  # -> XComponent, YComponent, ZComponent
pdecon_34 = Deconstruct(Point=cull_i_17)  # -> XComponent, YComponent, ZComponent
subtraction_33 = Subtraction(A=pdecon_33.XComponent, B=pdecon_34.XComponent)
subtraction_34 = Subtraction(A=pdecon_33.YComponent, B=pdecon_34.YComponent)
abs_33 = Absolute(Value=subtraction_34)
abs_34 = Absolute(Value=subtraction_33)
addition_18 = Addition(A=abs_34, B=abs_33)  # -> flatten(Result)
multiplication_17 = Multiplication(A=bang.Branch17, B=addition_18)
ma_19 = MassAddition(Input=multiplication_17)  # -> Result, PartialResults

area_center_re_ordered_list_18 = Data(area_2.Centroid)
split_18 = SplitList(List=area_center_re_ordered_list_18, Index=expr("x+1", "18"))  # -> ListA, ListB
cull_i_18 = CullIndex(List=split_18.ListA, Indices="18", Wrap=True)
item_60 = ListItem(List=split_18.ListA, Index="18", Wrap=True)
pdecon_35 = Deconstruct(Point=item_60)  # -> XComponent, YComponent, ZComponent
pdecon_36 = Deconstruct(Point=cull_i_18)  # -> XComponent, YComponent, ZComponent
subtraction_35 = Subtraction(A=pdecon_35.XComponent, B=pdecon_36.XComponent)
subtraction_36 = Subtraction(A=pdecon_35.YComponent, B=pdecon_36.YComponent)
abs_35 = Absolute(Value=subtraction_36)
abs_36 = Absolute(Value=subtraction_35)
addition_19 = Addition(A=abs_36, B=abs_35)  # -> flatten(Result)
multiplication_18 = Multiplication(A=bang.Branch18, B=addition_19)
ma_20 = MassAddition(Input=multiplication_18)  # -> Result, PartialResults

area_center_re_ordered_list_19 = Data(area_2.Centroid)
split_19 = SplitList(List=area_center_re_ordered_list_19, Index=expr("x+1", "19"))  # -> ListA, ListB
cull_i_19 = CullIndex(List=split_19.ListA, Indices="19", Wrap=True)
item_61 = ListItem(List=split_19.ListA, Index="19", Wrap=True)
pdecon_37 = Deconstruct(Point=item_61)  # -> XComponent, YComponent, ZComponent
pdecon_38 = Deconstruct(Point=cull_i_19)  # -> XComponent, YComponent, ZComponent
subtraction_37 = Subtraction(A=pdecon_37.XComponent, B=pdecon_38.XComponent)
subtraction_38 = Subtraction(A=pdecon_37.YComponent, B=pdecon_38.YComponent)
abs_37 = Absolute(Value=subtraction_38)
abs_38 = Absolute(Value=subtraction_37)
addition_20 = Addition(A=abs_38, B=abs_37)  # -> flatten(Result)
multiplication_19 = Multiplication(A=bang.Branch19, B=addition_20)
ma_21 = MassAddition(Input=multiplication_19)  # -> Result, PartialResults

area_center_re_ordered_list_20 = Data(area_2.Centroid)
split_20 = SplitList(List=area_center_re_ordered_list_20, Index=expr("x+1", "20"))  # -> ListA, ListB
cull_i_20 = CullIndex(List=split_20.ListA, Indices="20", Wrap=True)
item_62 = ListItem(List=split_20.ListA, Index="20", Wrap=True)
pdecon_39 = Deconstruct(Point=item_62)  # -> XComponent, YComponent, ZComponent
pdecon_40 = Deconstruct(Point=cull_i_20)  # -> XComponent, YComponent, ZComponent
subtraction_39 = Subtraction(A=pdecon_39.XComponent, B=pdecon_40.XComponent)
subtraction_40 = Subtraction(A=pdecon_39.YComponent, B=pdecon_40.YComponent)
abs_39 = Absolute(Value=subtraction_40)
abs_40 = Absolute(Value=subtraction_39)
addition_21 = Addition(A=abs_40, B=abs_39)  # -> flatten(Result)
multiplication_20 = Multiplication(A=bang.Branch20, B=addition_21)
ma_22 = MassAddition(Input=multiplication_20)  # -> Result, PartialResults

# ---- group: FINAL RESULT
merge_2 = Merge(
    Data1=ma_3.Result,
    Data2=ma_4.Result,
    Data3=ma_5.Result,
    Data4=ma_6.Result,
    Data5=ma_7.Result,
    Data6=ma_8.Result,
    Data7=ma_9.Result,
    Data8=ma_10.Result,
    Data9=ma_11.Result,
    Data10=ma_12.Result,
    Data11=ma_13.Result,
    Data12=ma_14.Result,
    Data13=ma_15.Result,
    Data14=ma_16.Result,
    Data15=ma_17.Result,
    Data16=ma_18.Result,
    Data17=ma_19.Result,
    Data18=ma_20.Result,
    Data19=ma_21.Result,
    Data20=ma_22.Result)  # -> flatten(Result)
number_slider_4 = Slider(3, range=0..10)
expression_3 = Expression(x="10", y=number_slider_4, Expression="x^y")
ma_23 = MassAddition(Input=merge_2)  # -> Result, PartialResults
division = Division(A=ma_23.Result, B=expression_3)
mass_final_resulting_distance = Number(division)
mass_final_resulting_distance_2 = Panel(mass_final_resulting_distance)

# ----
pt = ConstructPoint(XCoordinate=0, YCoordinate=0, ZCoordinate=0)
concat_2 = Concatenate(FragmentA=mass_final_resulting_distance, FragmentB=" x 10^", FragmentC=number_slider_4, FragmentD=" ft")
fitness = TextTag(Location=pt, Text=concat_2, Colour=ColourSwatch(SwatchColor=RGB(0, 0, 0)))

number_slider_5 = Slider(0.0032, range=0..1)  # disabled
data_list_2 = Data(panel_21)  # disabled
bang_2 = ExplodeTree(Data=data_list_2)  # -> Branch0, Branch1, Branch2, Branch3, Branch4, Branch5, Branch6, Branch7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; disabled
swatch = ColourSwatch(SwatchColor=RGB(0, 0, 0))  # disabled

# ---- group: LINKS
multiplier = Data(number_slider_5)  # disabled
area_center_re_ordered_list_21 = Data(area_2.Centroid)  # disabled
panel_23 = Panel("8")  # disabled
split_21 = SplitList(List=area_center_re_ordered_list_21, Index=expr("x+1", panel_23))  # -> ListA, ListB; disabled
cull_i_21 = CullIndex(List=split_21.ListA, Indices=panel_23, Wrap=True)  # disabled
item_63 = ListItem(List=split_21.ListA, Index=panel_23, Wrap=True)  # disabled
multiplication_21 = Multiplication(A=bang_2.Branch8, B=multiplier)  # disabled
ln = Line(StartPoint=item_63, EndPoint=cull_i_21)  # -> simplify(flatten(Line)); disabled
offset_4 = OffsetCurve(Curve=ln, Distance=multiplication_21, Plane=PlaneXY(0, 0, 0), Corners=1)  # -> simplify(flatten(Curve)); disabled
merge_3 = Merge(Data1=graft(ln), Data2=graft(offset_4))  # disabled
toggle = BooleanToggle(True)  # disabled
loft = Loft(Curves=merge_3, Options={Adjust=False, Closed=False, LoftEnds=0, LoftSimp=0, LoftType=0, Rebuild=10, Refit=0.01})  # disabled
clean = CleanTree(RemoveNulls=True, RemoveInvalid=True, RemoveEmpty=toggle, Tree=loft)  # -> flatten(Tree); disabled

multiplier_2 = Data(number_slider_5)  # disabled
area_center_re_ordered_list_22 = Data(area_2.Centroid)  # disabled
panel_24 = Panel("9")  # disabled
split_22 = SplitList(List=area_center_re_ordered_list_22, Index=expr("x+1", panel_24))  # -> ListA, ListB; disabled
cull_i_22 = CullIndex(List=split_22.ListA, Indices=panel_24, Wrap=True)  # disabled
item_64 = ListItem(List=split_22.ListA, Index=panel_24, Wrap=True)  # disabled
multiplication_22 = Multiplication(A=bang_2.Branch9, B=multiplier_2)  # disabled
ln_2 = Line(StartPoint=item_64, EndPoint=cull_i_22)  # -> simplify(flatten(Line)); disabled
offset_5 = OffsetCurve(Curve=ln_2, Distance=multiplication_22, Plane=PlaneXY(0, 0, 0), Corners=1)  # -> simplify(flatten(Curve)); disabled
merge_4 = Merge(Data1=graft(ln_2), Data2=graft(offset_5))  # disabled
toggle_2 = BooleanToggle(True)  # disabled
loft_2 = Loft(Curves=merge_4, Options={Adjust=False, Closed=False, LoftEnds=0, LoftSimp=0, LoftType=0, Rebuild=10, Refit=0.01})  # disabled
clean_2 = CleanTree(RemoveNulls=True, RemoveInvalid=True, RemoveEmpty=toggle_2, Tree=loft_2)  # -> flatten(Tree); disabled

multiplier_3 = Data(number_slider_5)  # disabled
area_center_re_ordered_list_23 = Data(area_2.Centroid)  # disabled
panel_25 = Panel("15")  # disabled
split_23 = SplitList(List=area_center_re_ordered_list_23, Index=expr("x+1", panel_25))  # -> ListA, ListB; disabled
cull_i_23 = CullIndex(List=split_23.ListA, Indices=panel_25, Wrap=True)  # disabled
item_65 = ListItem(List=split_23.ListA, Index=panel_25, Wrap=True)  # disabled
multiplication_23 = Multiplication(A=bang_2.Branch15, B=multiplier_3)  # disabled
ln_3 = Line(StartPoint=item_65, EndPoint=cull_i_23)  # -> simplify(flatten(Line)); disabled
offset_6 = OffsetCurve(Curve=ln_3, Distance=multiplication_23, Plane=PlaneXY(0, 0, 0), Corners=1)  # -> simplify(flatten(Curve)); disabled
merge_5 = Merge(Data1=graft(ln_3), Data2=graft(offset_6))  # disabled
toggle_3 = BooleanToggle(True)  # disabled
loft_3 = Loft(Curves=merge_5, Options={Adjust=False, Closed=False, LoftEnds=0, LoftSimp=0, LoftType=0, Rebuild=10, Refit=0.01})  # disabled
clean_3 = CleanTree(RemoveNulls=True, RemoveInvalid=True, RemoveEmpty=toggle_3, Tree=loft_3)  # -> flatten(Tree); disabled

multiplier_4 = Data(number_slider_5)  # disabled
area_center_re_ordered_list_24 = Data(area_2.Centroid)  # disabled
panel_26 = Panel("16")  # disabled
split_24 = SplitList(List=area_center_re_ordered_list_24, Index=expr("x+1", panel_26))  # -> ListA, ListB; disabled
cull_i_24 = CullIndex(List=split_24.ListA, Indices=panel_26, Wrap=True)  # disabled
item_66 = ListItem(List=split_24.ListA, Index=panel_26, Wrap=True)  # disabled
multiplication_24 = Multiplication(A=bang_2.Branch16, B=multiplier_4)  # disabled
ln_4 = Line(StartPoint=item_66, EndPoint=cull_i_24)  # -> simplify(flatten(Line)); disabled
offset_7 = OffsetCurve(Curve=ln_4, Distance=multiplication_24, Plane=PlaneXY(0, 0, 0), Corners=1)  # -> simplify(flatten(Curve)); disabled
merge_6 = Merge(Data1=graft(ln_4), Data2=graft(offset_7))  # disabled
toggle_4 = BooleanToggle(True)  # disabled
loft_4 = Loft(Curves=merge_6, Options={Adjust=False, Closed=False, LoftEnds=0, LoftSimp=0, LoftType=0, Rebuild=10, Refit=0.01})  # disabled
clean_4 = CleanTree(RemoveNulls=True, RemoveInvalid=True, RemoveEmpty=toggle_4, Tree=loft_4)  # -> flatten(Tree); disabled

multiplier_5 = Data(number_slider_5)  # disabled
area_center_re_ordered_list_25 = Data(area_2.Centroid)  # disabled
panel_27 = Panel("1")  # disabled
split_25 = SplitList(List=area_center_re_ordered_list_25, Index=expr("x+1", panel_27))  # -> ListA, ListB; disabled
cull_i_25 = CullIndex(List=split_25.ListA, Indices=panel_27, Wrap=True)  # disabled
item_67 = ListItem(List=split_25.ListA, Index=panel_27, Wrap=True)  # disabled
multiplication_25 = Multiplication(A=bang_2.Branch1, B=multiplier_5)  # disabled
ln_5 = Line(StartPoint=item_67, EndPoint=cull_i_25)  # -> simplify(flatten(Line)); disabled
offset_8 = OffsetCurve(Curve=ln_5, Distance=multiplication_25, Plane=PlaneXY(0, 0, 0), Corners=1)  # -> simplify(flatten(Curve)); disabled
merge_7 = Merge(Data1=graft(ln_5), Data2=graft(offset_8))  # disabled
toggle_5 = BooleanToggle(True)  # disabled
loft_5 = Loft(Curves=merge_7, Options={Adjust=False, Closed=False, LoftEnds=0, LoftSimp=0, LoftType=0, Rebuild=10, Refit=0.01})  # disabled
clean_5 = CleanTree(RemoveNulls=True, RemoveInvalid=True, RemoveEmpty=toggle_5, Tree=loft_5)  # -> flatten(Tree); disabled

multiplier_6 = Data(number_slider_5)  # disabled
area_center_re_ordered_list_26 = Data(area_2.Centroid)  # disabled
panel_28 = Panel("2")  # disabled
split_26 = SplitList(List=area_center_re_ordered_list_26, Index=expr("x+1", panel_28))  # -> ListA, ListB; disabled
cull_i_26 = CullIndex(List=split_26.ListA, Indices=panel_28, Wrap=True)  # disabled
item_68 = ListItem(List=split_26.ListA, Index=panel_28, Wrap=True)  # disabled
multiplication_26 = Multiplication(A=bang_2.Branch2, B=multiplier_6)  # disabled
ln_6 = Line(StartPoint=item_68, EndPoint=cull_i_26)  # -> simplify(flatten(Line)); disabled
offset_9 = OffsetCurve(Curve=ln_6, Distance=multiplication_26, Plane=PlaneXY(0, 0, 0), Corners=1)  # -> simplify(flatten(Curve)); disabled
merge_8 = Merge(Data1=graft(ln_6), Data2=graft(offset_9))  # disabled
toggle_6 = BooleanToggle(True)  # disabled
loft_6 = Loft(Curves=merge_8, Options={Adjust=False, Closed=False, LoftEnds=0, LoftSimp=0, LoftType=0, Rebuild=10, Refit=0.01})  # disabled
clean_6 = CleanTree(RemoveNulls=True, RemoveInvalid=True, RemoveEmpty=toggle_6, Tree=loft_6)  # -> flatten(Tree); disabled

multiplier_7 = Data(number_slider_5)  # disabled
area_center_re_ordered_list_27 = Data(area_2.Centroid)  # disabled
panel_29 = Panel("10")  # disabled
split_27 = SplitList(List=area_center_re_ordered_list_27, Index=expr("x+1", panel_29))  # -> ListA, ListB; disabled
cull_i_27 = CullIndex(List=split_27.ListA, Indices=panel_29, Wrap=True)  # disabled
item_69 = ListItem(List=split_27.ListA, Index=panel_29, Wrap=True)  # disabled
multiplication_27 = Multiplication(A=bang_2.Branch10, B=multiplier_7)  # disabled
ln_7 = Line(StartPoint=item_69, EndPoint=cull_i_27)  # -> simplify(flatten(Line)); disabled
offset_10 = OffsetCurve(Curve=ln_7, Distance=multiplication_27, Plane=PlaneXY(0, 0, 0), Corners=1)  # -> simplify(flatten(Curve)); disabled
merge_9 = Merge(Data1=graft(ln_7), Data2=graft(offset_10))  # disabled
toggle_7 = BooleanToggle(True)  # disabled
loft_7 = Loft(Curves=merge_9, Options={Adjust=False, Closed=False, LoftEnds=0, LoftSimp=0, LoftType=0, Rebuild=10, Refit=0.01})  # disabled
clean_7 = CleanTree(RemoveNulls=True, RemoveInvalid=True, RemoveEmpty=toggle_7, Tree=loft_7)  # -> flatten(Tree); disabled

multiplier_8 = Data(number_slider_5)  # disabled
area_center_re_ordered_list_28 = Data(area_2.Centroid)  # disabled
panel_30 = Panel("11")  # disabled
split_28 = SplitList(List=area_center_re_ordered_list_28, Index=expr("x+1", panel_30))  # -> ListA, ListB; disabled
cull_i_28 = CullIndex(List=split_28.ListA, Indices=panel_30, Wrap=True)  # disabled
item_70 = ListItem(List=split_28.ListA, Index=panel_30, Wrap=True)  # disabled
multiplication_28 = Multiplication(A=bang_2.Branch11, B=multiplier_8)  # disabled
ln_8 = Line(StartPoint=item_70, EndPoint=cull_i_28)  # -> simplify(flatten(Line)); disabled
offset_11 = OffsetCurve(Curve=ln_8, Distance=multiplication_28, Plane=PlaneXY(0, 0, 0), Corners=1)  # -> simplify(flatten(Curve)); disabled
merge_10 = Merge(Data1=graft(ln_8), Data2=graft(offset_11))  # disabled
toggle_8 = BooleanToggle(True)  # disabled
loft_8 = Loft(Curves=merge_10, Options={Adjust=False, Closed=False, LoftEnds=0, LoftSimp=0, LoftType=0, Rebuild=10, Refit=0.01})  # disabled
clean_8 = CleanTree(RemoveNulls=True, RemoveInvalid=True, RemoveEmpty=toggle_8, Tree=loft_8)  # -> flatten(Tree); disabled

multiplier_9 = Data(number_slider_5)  # disabled
area_center_re_ordered_list_29 = Data(area_2.Centroid)  # disabled
panel_31 = Panel("12")  # disabled
split_29 = SplitList(List=area_center_re_ordered_list_29, Index=expr("x+1", panel_31))  # -> ListA, ListB; disabled
cull_i_29 = CullIndex(List=split_29.ListA, Indices=panel_31, Wrap=True)  # disabled
item_71 = ListItem(List=split_29.ListA, Index=panel_31, Wrap=True)  # disabled
multiplication_29 = Multiplication(A=bang_2.Branch12, B=multiplier_9)  # disabled
ln_9 = Line(StartPoint=item_71, EndPoint=cull_i_29)  # -> simplify(flatten(Line)); disabled
offset_12 = OffsetCurve(Curve=ln_9, Distance=multiplication_29, Plane=PlaneXY(0, 0, 0), Corners=1)  # -> simplify(flatten(Curve)); disabled
merge_11 = Merge(Data1=graft(ln_9), Data2=graft(offset_12))  # disabled
toggle_9 = BooleanToggle(True)  # disabled
loft_9 = Loft(Curves=merge_11, Options={Adjust=False, Closed=False, LoftEnds=0, LoftSimp=0, LoftType=0, Rebuild=10, Refit=0.01})  # disabled
clean_9 = CleanTree(RemoveNulls=True, RemoveInvalid=True, RemoveEmpty=toggle_9, Tree=loft_9)  # -> flatten(Tree); disabled

multiplier_10 = Data(number_slider_5)  # disabled
area_center_re_ordered_list_30 = Data(area_2.Centroid)  # disabled
panel_32 = Panel("13")  # disabled
split_30 = SplitList(List=area_center_re_ordered_list_30, Index=expr("x+1", panel_32))  # -> ListA, ListB; disabled
cull_i_30 = CullIndex(List=split_30.ListA, Indices=panel_32, Wrap=True)  # disabled
item_72 = ListItem(List=split_30.ListA, Index=panel_32, Wrap=True)  # disabled
multiplication_30 = Multiplication(A=bang_2.Branch13, B=multiplier_10)  # disabled
ln_10 = Line(StartPoint=item_72, EndPoint=cull_i_30)  # -> simplify(flatten(Line)); disabled
offset_13 = OffsetCurve(Curve=ln_10, Distance=multiplication_30, Plane=PlaneXY(0, 0, 0), Corners=1)  # -> simplify(flatten(Curve)); disabled
merge_12 = Merge(Data1=graft(ln_10), Data2=graft(offset_13))  # disabled
toggle_10 = BooleanToggle(True)  # disabled
loft_10 = Loft(Curves=merge_12, Options={Adjust=False, Closed=False, LoftEnds=0, LoftSimp=0, LoftType=0, Rebuild=10, Refit=0.01})  # disabled
clean_10 = CleanTree(RemoveNulls=True, RemoveInvalid=True, RemoveEmpty=toggle_10, Tree=loft_10)  # -> flatten(Tree); disabled

multiplier_11 = Data(number_slider_5)  # disabled
area_center_re_ordered_list_31 = Data(area_2.Centroid)  # disabled
panel_33 = Panel("3")  # disabled
split_31 = SplitList(List=area_center_re_ordered_list_31, Index=expr("x+1", panel_33))  # -> ListA, ListB; disabled
cull_i_31 = CullIndex(List=split_31.ListA, Indices=panel_33, Wrap=True)  # disabled
item_73 = ListItem(List=split_31.ListA, Index=panel_33, Wrap=True)  # disabled
multiplication_31 = Multiplication(A=bang_2.Branch3, B=multiplier_11)  # disabled
ln_11 = Line(StartPoint=item_73, EndPoint=cull_i_31)  # -> simplify(flatten(Line)); disabled
offset_14 = OffsetCurve(Curve=ln_11, Distance=multiplication_31, Plane=PlaneXY(0, 0, 0), Corners=1)  # -> simplify(flatten(Curve)); disabled
merge_13 = Merge(Data1=graft(ln_11), Data2=graft(offset_14))  # disabled
toggle_11 = BooleanToggle(True)  # disabled
loft_11 = Loft(Curves=merge_13, Options={Adjust=False, Closed=False, LoftEnds=0, LoftSimp=0, LoftType=0, Rebuild=10, Refit=0.01})  # disabled
clean_11 = CleanTree(RemoveNulls=True, RemoveInvalid=True, RemoveEmpty=toggle_11, Tree=loft_11)  # -> flatten(Tree); disabled

multiplier_12 = Data(number_slider_5)  # disabled
area_center_re_ordered_list_32 = Data(area_2.Centroid)  # disabled
panel_34 = Panel("4")  # disabled
split_32 = SplitList(List=area_center_re_ordered_list_32, Index=expr("x+1", panel_34))  # -> ListA, ListB; disabled
cull_i_32 = CullIndex(List=split_32.ListA, Indices=panel_34, Wrap=True)  # disabled
item_74 = ListItem(List=split_32.ListA, Index=panel_34, Wrap=True)  # disabled
multiplication_32 = Multiplication(A=bang_2.Branch4, B=multiplier_12)  # disabled
ln_12 = Line(StartPoint=item_74, EndPoint=cull_i_32)  # -> simplify(flatten(Line)); disabled
offset_15 = OffsetCurve(Curve=ln_12, Distance=multiplication_32, Plane=PlaneXY(0, 0, 0), Corners=1)  # -> simplify(flatten(Curve)); disabled
merge_14 = Merge(Data1=graft(ln_12), Data2=graft(offset_15))  # disabled
toggle_12 = BooleanToggle(True)  # disabled
loft_12 = Loft(Curves=merge_14, Options={Adjust=False, Closed=False, LoftEnds=0, LoftSimp=0, LoftType=0, Rebuild=10, Refit=0.01})  # disabled
clean_12 = CleanTree(RemoveNulls=True, RemoveInvalid=True, RemoveEmpty=toggle_12, Tree=loft_12)  # -> flatten(Tree); disabled

multiplier_13 = Data(number_slider_5)  # disabled
area_center_re_ordered_list_33 = Data(area_2.Centroid)  # disabled
panel_35 = Panel("5")  # disabled
split_33 = SplitList(List=area_center_re_ordered_list_33, Index=expr("x+1", panel_35))  # -> ListA, ListB; disabled
cull_i_33 = CullIndex(List=split_33.ListA, Indices=panel_35, Wrap=True)  # disabled
item_75 = ListItem(List=split_33.ListA, Index=panel_35, Wrap=True)  # disabled
multiplication_33 = Multiplication(A=bang_2.Branch5, B=multiplier_13)  # disabled
ln_13 = Line(StartPoint=item_75, EndPoint=cull_i_33)  # -> simplify(flatten(Line)); disabled
offset_16 = OffsetCurve(Curve=ln_13, Distance=multiplication_33, Plane=PlaneXY(0, 0, 0), Corners=1)  # -> simplify(flatten(Curve)); disabled
merge_15 = Merge(Data1=graft(ln_13), Data2=graft(offset_16))  # disabled
toggle_13 = BooleanToggle(True)  # disabled
loft_13 = Loft(Curves=merge_15, Options={Adjust=False, Closed=False, LoftEnds=0, LoftSimp=0, LoftType=0, Rebuild=10, Refit=0.01})  # disabled
clean_13 = CleanTree(RemoveNulls=True, RemoveInvalid=True, RemoveEmpty=toggle_13, Tree=loft_13)  # -> flatten(Tree); disabled

multiplier_14 = Data(number_slider_5)  # disabled
area_center_re_ordered_list_34 = Data(area_2.Centroid)  # disabled
panel_36 = Panel("6")  # disabled
split_34 = SplitList(List=area_center_re_ordered_list_34, Index=expr("x+1", panel_36))  # -> ListA, ListB; disabled
cull_i_34 = CullIndex(List=split_34.ListA, Indices=panel_36, Wrap=True)  # disabled
item_76 = ListItem(List=split_34.ListA, Index=panel_36, Wrap=True)  # disabled
multiplication_34 = Multiplication(A=bang_2.Branch6, B=multiplier_14)  # disabled
ln_14 = Line(StartPoint=item_76, EndPoint=cull_i_34)  # -> simplify(flatten(Line)); disabled
offset_17 = OffsetCurve(Curve=ln_14, Distance=multiplication_34, Plane=PlaneXY(0, 0, 0), Corners=1)  # -> simplify(flatten(Curve)); disabled
merge_16 = Merge(Data1=graft(ln_14), Data2=graft(offset_17))  # disabled
toggle_14 = BooleanToggle(True)  # disabled
loft_14 = Loft(Curves=merge_16, Options={Adjust=False, Closed=False, LoftEnds=0, LoftSimp=0, LoftType=0, Rebuild=10, Refit=0.01})  # disabled
clean_14 = CleanTree(RemoveNulls=True, RemoveInvalid=True, RemoveEmpty=toggle_14, Tree=loft_14)  # -> flatten(Tree); disabled

multiplier_15 = Data(number_slider_5)  # disabled
area_center_re_ordered_list_35 = Data(area_2.Centroid)  # disabled
panel_37 = Panel("17")  # disabled
split_35 = SplitList(List=area_center_re_ordered_list_35, Index=expr("x+1", panel_37))  # -> ListA, ListB; disabled
cull_i_35 = CullIndex(List=split_35.ListA, Indices=panel_37, Wrap=True)  # disabled
item_77 = ListItem(List=split_35.ListA, Index=panel_37, Wrap=True)  # disabled
multiplication_35 = Multiplication(A=bang_2.Branch17, B=multiplier_15)  # disabled
ln_15 = Line(StartPoint=item_77, EndPoint=cull_i_35)  # -> simplify(flatten(Line)); disabled
offset_18 = OffsetCurve(Curve=ln_15, Distance=multiplication_35, Plane=PlaneXY(0, 0, 0), Corners=1)  # -> simplify(flatten(Curve)); disabled
merge_17 = Merge(Data1=graft(ln_15), Data2=graft(offset_18))  # disabled
toggle_15 = BooleanToggle(True)  # disabled
loft_15 = Loft(Curves=merge_17, Options={Adjust=False, Closed=False, LoftEnds=0, LoftSimp=0, LoftType=0, Rebuild=10, Refit=0.01})  # disabled
clean_15 = CleanTree(RemoveNulls=True, RemoveInvalid=True, RemoveEmpty=toggle_15, Tree=loft_15)  # -> flatten(Tree); disabled

multiplier_16 = Data(number_slider_5)  # disabled
area_center_re_ordered_list_36 = Data(area_2.Centroid)  # disabled
panel_38 = Panel("18")  # disabled
split_36 = SplitList(List=area_center_re_ordered_list_36, Index=expr("x+1", panel_38))  # -> ListA, ListB; disabled
cull_i_36 = CullIndex(List=split_36.ListA, Indices=panel_38, Wrap=True)  # disabled
item_78 = ListItem(List=split_36.ListA, Index=panel_38, Wrap=True)  # disabled
multiplication_36 = Multiplication(A=bang_2.Branch18, B=multiplier_16)  # disabled
ln_16 = Line(StartPoint=item_78, EndPoint=cull_i_36)  # -> simplify(flatten(Line)); disabled
offset_19 = OffsetCurve(Curve=ln_16, Distance=multiplication_36, Plane=PlaneXY(0, 0, 0), Corners=1)  # -> simplify(flatten(Curve)); disabled
merge_18 = Merge(Data1=graft(ln_16), Data2=graft(offset_19))  # disabled
toggle_16 = BooleanToggle(True)  # disabled
loft_16 = Loft(Curves=merge_18, Options={Adjust=False, Closed=False, LoftEnds=0, LoftSimp=0, LoftType=0, Rebuild=10, Refit=0.01})  # disabled
clean_16 = CleanTree(RemoveNulls=True, RemoveInvalid=True, RemoveEmpty=toggle_16, Tree=loft_16)  # -> flatten(Tree); disabled

multiplier_17 = Data(number_slider_5)  # disabled
area_center_re_ordered_list_37 = Data(area_2.Centroid)  # disabled
panel_39 = Panel("19")  # disabled
split_37 = SplitList(List=area_center_re_ordered_list_37, Index=expr("x+1", panel_39))  # -> ListA, ListB; disabled
cull_i_37 = CullIndex(List=split_37.ListA, Indices=panel_39, Wrap=True)  # disabled
item_79 = ListItem(List=split_37.ListA, Index=panel_39, Wrap=True)  # disabled
multiplication_37 = Multiplication(A=bang_2.Branch19, B=multiplier_17)  # disabled
ln_17 = Line(StartPoint=item_79, EndPoint=cull_i_37)  # -> simplify(flatten(Line)); disabled
offset_20 = OffsetCurve(Curve=ln_17, Distance=multiplication_37, Plane=PlaneXY(0, 0, 0), Corners=1)  # -> simplify(flatten(Curve)); disabled
merge_19 = Merge(Data1=graft(ln_17), Data2=graft(offset_20))  # disabled
toggle_17 = BooleanToggle(True)  # disabled
loft_17 = Loft(Curves=merge_19, Options={Adjust=False, Closed=False, LoftEnds=0, LoftSimp=0, LoftType=0, Rebuild=10, Refit=0.01})  # disabled
clean_17 = CleanTree(RemoveNulls=True, RemoveInvalid=True, RemoveEmpty=toggle_17, Tree=loft_17)  # -> flatten(Tree); disabled

multiplier_18 = Data(number_slider_5)  # disabled
area_center_re_ordered_list_38 = Data(area_2.Centroid)  # disabled
panel_40 = Panel("20")  # disabled
split_38 = SplitList(List=area_center_re_ordered_list_38, Index=expr("x+1", panel_40))  # -> ListA, ListB; disabled
cull_i_38 = CullIndex(List=split_38.ListA, Indices=panel_40, Wrap=True)  # disabled
item_80 = ListItem(List=split_38.ListA, Index=panel_40, Wrap=True)  # disabled
multiplication_38 = Multiplication(A=bang_2.Branch20, B=multiplier_18)  # disabled
ln_18 = Line(StartPoint=item_80, EndPoint=cull_i_38)  # -> simplify(flatten(Line)); disabled
offset_21 = OffsetCurve(Curve=ln_18, Distance=multiplication_38, Plane=PlaneXY(0, 0, 0), Corners=1)  # -> simplify(flatten(Curve)); disabled
merge_20 = Merge(Data1=graft(ln_18), Data2=graft(offset_21))  # disabled
toggle_18 = BooleanToggle(True)  # disabled
loft_18 = Loft(Curves=merge_20, Options={Adjust=False, Closed=False, LoftEnds=0, LoftSimp=0, LoftType=0, Rebuild=10, Refit=0.01})  # disabled
clean_18 = CleanTree(RemoveNulls=True, RemoveInvalid=True, RemoveEmpty=toggle_18, Tree=loft_18)  # -> flatten(Tree); disabled

multiplier_19 = Data(number_slider_5)  # disabled
area_center_re_ordered_list_39 = Data(area_2.Centroid)  # disabled
panel_41 = Panel("14")  # disabled
split_39 = SplitList(List=area_center_re_ordered_list_39, Index=expr("x+1", panel_41))  # -> ListA, ListB; disabled
cull_i_39 = CullIndex(List=split_39.ListA, Indices=panel_41, Wrap=True)  # disabled
item_81 = ListItem(List=split_39.ListA, Index=panel_41, Wrap=True)  # disabled
multiplication_39 = Multiplication(A=bang_2.Branch14, B=multiplier_19)  # disabled
ln_19 = Line(StartPoint=item_81, EndPoint=cull_i_39)  # -> simplify(flatten(Line)); disabled
offset_22 = OffsetCurve(Curve=ln_19, Distance=multiplication_39, Plane=PlaneXY(0, 0, 0), Corners=1)  # -> simplify(flatten(Curve)); disabled
merge_21 = Merge(Data1=graft(ln_19), Data2=graft(offset_22))  # disabled
toggle_19 = BooleanToggle(True)  # disabled
loft_19 = Loft(Curves=merge_21, Options={Adjust=False, Closed=False, LoftEnds=0, LoftSimp=0, LoftType=0, Rebuild=10, Refit=0.01})  # disabled
clean_19 = CleanTree(RemoveNulls=True, RemoveInvalid=True, RemoveEmpty=toggle_19, Tree=loft_19)  # -> flatten(Tree); disabled

multiplier_20 = Data(number_slider_5)  # disabled
area_center_re_ordered_list_40 = Data(area_2.Centroid)  # disabled
panel_42 = Panel("7")  # disabled
split_40 = SplitList(List=area_center_re_ordered_list_40, Index=expr("x+1", panel_42))  # -> ListA, ListB; disabled
cull_i_40 = CullIndex(List=split_40.ListA, Indices=panel_42, Wrap=True)  # disabled
item_82 = ListItem(List=split_40.ListA, Index=panel_42, Wrap=True)  # disabled
multiplication_40 = Multiplication(A=bang_2.Branch7, B=multiplier_20)  # disabled
ln_20 = Line(StartPoint=item_82, EndPoint=cull_i_40)  # -> simplify(flatten(Line)); disabled
offset_23 = OffsetCurve(Curve=ln_20, Distance=multiplication_40, Plane=PlaneXY(0, 0, 0), Corners=1)  # -> simplify(flatten(Curve)); disabled
merge_22 = Merge(Data1=graft(ln_20), Data2=graft(offset_23))  # disabled
toggle_20 = BooleanToggle(True)  # disabled
loft_20 = Loft(Curves=merge_22, Options={Adjust=False, Closed=False, LoftEnds=0, LoftSimp=0, LoftType=0, Rebuild=10, Refit=0.01})  # disabled
clean_20 = CleanTree(RemoveNulls=True, RemoveInvalid=True, RemoveEmpty=toggle_20, Tree=loft_20)  # -> flatten(Tree); disabled

# ----
merge_23 = Merge(
    Data1=clean_5,
    Data2=clean_6,
    Data3=clean_11,
    Data4=clean_12,
    Data5=clean_13,
    Data6=clean_14,
    Data7=clean_20,
    Data8=clean,
    Data9=clean_2,
    Data10=clean_7,
    Data11=clean_8,
    Data12=clean_9,
    Data13=clean_10,
    Data14=clean_19,
    Data15=clean_3,
    Data16=clean_4,
    Data17=clean_15,
    Data18=clean_16,
    Data19=clean_17,
    Data20=clean_18)  # disabled
preview_2 = CustomPreview(Geometry=merge_23, Material=swatch)  # disabled

# ---- group: WALL
wall_thickness_3 = Number(number_slider_3)

neg_3 = Negative(Value=wall_thickness_3)
offset_24 = OffsetCurve(Curve=merge, Distance=expr("x/4", neg_3), Plane=PlaneXY(0, 0, 0), Corners=1)
geo_2 = Geometry(graft(merge))
merge_24 = Merge(Data1=geo_2, Data2=offset_24)

geo_3 = Geometry(graft(offset_2))
offset_25 = OffsetCurve(Curve=offset_2, Distance=wall_thickness_3, Plane=PlaneXY(0, 0, 0), Corners=1)
merge_25 = Merge(Data1=geo_3, Data2=offset_25)

boundary_3 = BoundarySurfaces(Edges=merge_24)  # -> flatten(Surfaces)
boundary_4 = BoundarySurfaces(Edges=merge_25)  # -> flatten(Surfaces)
join = BrepJoin(Breps=[boundary_4, boundary_3])  # -> Breps, Closed
merge_26 = Merge(Data1=geo_3, Data2=geo_2)
merge_27 = Merge(Data1=offset_25, Data2=offset_24)
plan_outline = Curve(merge_27)
cell_outline = Curve(merge_26)
preview_3 = CustomPreview(Geometry=join.Breps, Material=ColourSwatch(SwatchColor=RGB(0, 0, 0)))
wall = Geometry(join.Breps)
